# Grasshopper definition HeatFlux.ghx (Grasshopper 1.0.7)

# ----
# Select  Components and wire type
# Press button (new version)
button = Button()
list = ValueList({"Default": 0, "Faint": 1, "Hidden": 2}, selected="Faint")
wirecleaner = WireCleaner(on=button, wire_type=list)  # -> out, a
# ---------- wirecleaner: Python ----------
from Grasshopper.Kernel import GH_ParamWireDisplay
from Grasshopper.Kernel import GH_RuntimeMessageLevel 

# A dictionary of wire types 
wire_display = {'0':GH_ParamWireDisplay.default, 
                '1':GH_ParamWireDisplay.faint,
                '2':GH_ParamWireDisplay.hidden}

# Get selected components and change the wire display
if on:
    doc = ghenv.Component.OnPingDocument()
    sel_objs = doc.SelectedObjects()
    if not len(sel_objs):
        ghenv.Component.AddRuntimeMessage(GH_RuntimeMessageLevel.Warning, 'Nothing was selected')
    for sel_obj  in sel_objs:
        if hasattr(sel_obj, 'Params'):
            for p in sel_obj.Params.Input:
                p.WireDisplay = wire_display[wire_type]
        else:
                sel_obj.WireDisplay = wire_display[wire_type]
# ---------- end wirecleaner ----------

document_path = CSharpScript()  # -> out, A
# ---------- document_path: C# usings ----------
using System.IO;
# ---------- document_path: C# ----------
    GH_Document gh_d = owner.OnPingDocument();

    if (gh_d.IsFilePathDefined)
    {
      Print("A path is defined.");
      A = System.IO.Path.GetDirectoryName(gh_d.FilePath);
    }
    else
    {
      Print("No path defined.");
    }
# ---------- end document_path ----------
# Density
panel = Panel("1000")
# Brick
panel_2 = Panel("2300")
# Conductivity
# Heat capacity
panel_3 = Panel("0.08")
# Density
panel_4 = Panel("920")
# Insulation
panel_5 = Panel("710")
# Heat capacity
# Density
panel_6 = Panel("1450")
# Density
# Plaster (outside)
panel_7 = Panel("1400")
# Density
# Acustic insulation
panel_8 = Panel("2000")
# Conductivity
# Heat capacity
panel_9 = Panel("0.041")
# Density
# Randdämmstreifen
panel_10 = Panel("15")
# Conductivity
# Heat capacity
panel_11 = Panel("0.04")
# Density
panel_12 = Panel("70")
# Materials
panel_13 = Panel("9999")
# Concrete
# Conductivity
# Heat capacity
panel_14 = Panel("2.3")
# Conductivity
panel_15 = Panel("0.039")
# Plaster (inside)
panel_16 = Panel("35")
# Conductivity
# Heat capacity
panel_17 = Panel("0.7")
# Conductivity
# Heat capacity
panel_18 = Panel("0.87")
# Density
panel_19 = Panel("1100")
# Cement screed
panel_20 = Panel("1800")
# Conductivity
# Heat capacity
panel_21 = Panel("1.33")

# ----
# Boundary surfaces
panel_22 = Panel("-5")
tokelvin = ToKelvin(A=panel_22)
tokelvin_2 = ToKelvin(A="-5")
tokelvin_3 = ToKelvin(A="20")
tokelvin_4 = ToKelvin(A="20")
panel_23 = Panel(tokelvin)
panel_24 = Panel("zeroGradient")
panel_25 = Panel(tokelvin_2)
panel_26 = Panel(tokelvin_4)
panel_27 = Panel(tokelvin_3)
geo = Geometry(<brep referenced from the Rhino model>)
geo_2 = Geometry(<brep referenced from the Rhino model>)
geo_3 = Geometry(<brep referenced from the Rhino model>)
geo_4 = Geometry(<brep referenced from the Rhino model>)
geo_5 = Geometry(<brep referenced from the Rhino model>)
geo_6 = Geometry(<brep referenced from the Rhino model>)
panel_30 = Panel("250")
geo_7 = Geometry(<brep referenced from the Rhino model>)
geo_8 = Geometry(<brep referenced from the Rhino model>)
geo_9 = Geometry(<brep referenced from the Rhino model>)
geo_10 = Geometry(<brep referenced from the Rhino model>)
geo_11 = Geometry(<brep referenced from the Rhino model>)
geo_12 = Geometry(<brep referenced from the Rhino model>)
geo_13 = Geometry(<brep referenced from the Rhino model>)
geo_14 = Geometry(<brep referenced from the Rhino model>)
geo_15 = Geometry(<brep referenced from the Rhino model>)
geo_16 = Geometry(<brep referenced from the Rhino model>)
attachtouserdictionary = CSharpScript(geo=geo_4, valName="right_to_zone_10", valType="fixedValue", valTemp=panel_27)  # -> out, flatten(A); inputs geo: GeometryBase, valName: String, valType: String, valTemp: String
# ---------- attachtouserdictionary: C# usings ----------
using System.IO;
using System.Linq;
using System.Data;
using System.Drawing;
using System.Reflection;
using System.Windows.Forms;
using System.Xml;
using System.Xml.Linq;
using System.Runtime.InteropServices;

using Rhino.DocObjects;
using Rhino.Collections;
using GH_IO;
using GH_IO.Serialization;
# ---------- attachtouserdictionary: C# ----------
    geo.UserDictionary.Set("type", valType);
    geo.UserDictionary.Set("temp", valTemp);
    geo.UserDictionary.Set("name", valName);
    //geo.UserDictionary.Set("OF_Temp", 99);
    /*
    if(bake){
    RhinoDocument.Objects.Add(geo);
    }
    */
    A = geo;
# ---------- end attachtouserdictionary ----------
attachtouserdictionary_2 = CSharpScript(geo=geo, valName="bottom_to_zone_2", valType="fixedValue", valTemp=panel_25)  # -> out, flatten(A); inputs geo: GeometryBase, valName: String, valType: String, valTemp: String; same code as attachtouserdictionary
attachtouserdictionary_3 = CSharpScript(geo=geo_2, valName="bottom_to_zone_4", valType="fixedValue", valTemp=panel_25)  # -> out, flatten(A); inputs geo: GeometryBase, valName: String, valType: String, valTemp: String; same code as attachtouserdictionary
attachtouserdictionary_4 = CSharpScript(geo=geo_5, valName="zone_12_to_zone_4", valType="fixedValue", valTemp=panel_26)  # -> out, flatten(A); inputs geo: GeometryBase, valName: String, valType: String, valTemp: String; same code as attachtouserdictionary
attachtouserdictionary_5 = CSharpScript(geo=geo_3, valName="bottom_to_zone_3", valType="fixedValue", valTemp=panel_25)  # -> out, flatten(A); inputs geo: GeometryBase, valName: String, valType: String, valTemp: String; same code as attachtouserdictionary
attachtouserdictionary_6 = CSharpScript(geo=geo_8, valName="right_to_zone_5", valType="fixedValue", valTemp=panel_27)  # -> out, flatten(A); inputs geo: GeometryBase, valName: String, valType: String, valTemp: String; same code as attachtouserdictionary
attachtouserdictionary_7 = CSharpScript(geo=geo_6, valName="zone_12_to_zone_10", valType="fixedValue", valTemp=panel_26)  # -> out, flatten(A); inputs geo: GeometryBase, valName: String, valType: String, valTemp: String; same code as attachtouserdictionary
attachtouserdictionary_8 = CSharpScript(geo=geo_7, valName="right_to_zone_7", valType="fixedValue", valTemp=panel_27)  # -> out, flatten(A); inputs geo: GeometryBase, valName: String, valType: String, valTemp: String; same code as attachtouserdictionary
attachtouserdictionary_9 = CSharpScript(geo=geo_9, valName="right_to_zone_6", valType="fixedValue", valTemp=panel_27)  # -> out, flatten(A); inputs geo: GeometryBase, valName: String, valType: String, valTemp: String; same code as attachtouserdictionary
attachtouserdictionary_10 = CSharpScript(geo=geo_10, valName="top_to_zone_1", valType="fixedValue", valTemp=panel_23)  # -> out, flatten(A); inputs geo: GeometryBase, valName: String, valType: String, valTemp: String; same code as attachtouserdictionary
attachtouserdictionary_11 = CSharpScript(geo=geo_11, valName="zone_11_to_zone_8", valType="fixedValue", valTemp=panel_27)  # -> out, flatten(A); inputs geo: GeometryBase, valName: String, valType: String, valTemp: String; same code as attachtouserdictionary
attachtouserdictionary_12 = CSharpScript(geo=geo_13, valName="zone_11_to_zone_6", valType="fixedValue", valTemp=panel_27)  # -> out, flatten(A); inputs geo: GeometryBase, valName: String, valType: String, valTemp: String; same code as attachtouserdictionary
attachtouserdictionary_13 = CSharpScript(geo=geo_12, valName="zone_11_to_zone_1", valType="fixedValue", valTemp=panel_27)  # -> out, flatten(A); inputs geo: GeometryBase, valName: String, valType: String, valTemp: String; same code as attachtouserdictionary
attachtouserdictionary_14 = CSharpScript(geo=geo_14, valName="left_to_zone_2", valType="fixedValue", valTemp=panel_23)  # -> out, flatten(A); inputs geo: GeometryBase, valName: String, valType: String, valTemp: String; same code as attachtouserdictionary
attachtouserdictionary_15 = CSharpScript(geo=geo_15, valName="top_to_zone_0", valType="fixedValue", valTemp=panel_23)  # -> out, flatten(A); inputs geo: GeometryBase, valName: String, valType: String, valTemp: String; same code as attachtouserdictionary
attachtouserdictionary_16 = CSharpScript(geo=geo_16, valName="top_to_zone_2", valType="fixedValue", valTemp=panel_23)  # -> out, flatten(A); inputs geo: GeometryBase, valName: String, valType: String, valTemp: String; same code as attachtouserdictionary

# ----
# Air
panel_33 = Panel("fixedValue")
brep = Brep(<brep referenced from the Rhino model>)
brep_2 = Brep(<brep referenced from the Rhino model>)
panel_34 = Panel("2000")
panel_35 = Panel("1800")
panel_36 = Panel("empty")
attachtouserdictionary_17 = CSharpScript(
    geo=brep_2,
    valName="zone_11",
    valType=panel_33,
    valTemp="200",
    valThermalConductivity=panel_13,
    valDensity=panel_13,
    valSpecificHeatCapacity=panel_13)  # -> out, flatten(A); inputs geo: GeometryBase, valName: String, valType: String, valTemp: String, valThermalConductivity: String, valDensity: String, valSpecificHeatCapacity: String
# ---------- attachtouserdictionary_17: C# ----------
    geo.UserDictionary.Set("type", valType);
    geo.UserDictionary.Set("temp", valTemp);
    geo.UserDictionary.Set("name", valName);
    geo.UserDictionary.Set("thermalconductivity", valThermalConductivity);
    geo.UserDictionary.Set("density", valDensity);
    geo.UserDictionary.Set("heatcapacity", valSpecificHeatCapacity);
    /*
    if(bake){
    RhinoDocument.Objects.Add(geo);
    }
    */
    A = geo;
# ---------- end attachtouserdictionary_17 ----------
attachtouserdictionary_18 = CSharpScript(
    geo=brep,
    valName="zone_12",
    valType=panel_33,
    valTemp="200",
    valThermalConductivity=panel_13,
    valDensity=panel_13,
    valSpecificHeatCapacity=panel_13)  # -> out, flatten(A); inputs geo: GeometryBase, valName: String, valType: String, valTemp: String, valThermalConductivity: String, valDensity: String, valSpecificHeatCapacity: String; same code as attachtouserdictionary_17

# ----
# Solids
panel_38 = Panel("zone_13")
brep_3 = Brep(<brep referenced from the Rhino model>)
brep_4 = Brep(<brep referenced from the Rhino model>)
brep_5 = Brep(<brep referenced from the Rhino model>)
brep_6 = Brep(<brep referenced from the Rhino model>)
brep_7 = Brep(<brep referenced from the Rhino model>)
brep_8 = Brep(<brep referenced from the Rhino model>)
brep_9 = Brep(<brep referenced from the Rhino model>)
brep_10 = Brep(<brep referenced from the Rhino model>)
brep_11 = Brep(<brep referenced from the Rhino model>)
brep_12 = Brep(<brep referenced from the Rhino model>)
brep_13 = Brep(<brep referenced from the Rhino model>)
brep_14 = Brep(<brep referenced from the Rhino model>)
attachtouserdictionary_19 = CSharpScript(geo=brep_14, valName="zone_0", valThermalConductivity=panel_3, valDensity=panel_5, valSpecificHeatCapacity=panel_4)  # -> out, flatten(A); inputs geo: GeometryBase, valName: String, valType: String, valTemp: String, valThermalConductivity: String, valDensity: String, valSpecificHeatCapacity: String
# ---------- attachtouserdictionary_19: C# ----------
    geo.UserDictionary.Set("type", valType);
    geo.UserDictionary.Set("temp", valTemp);
    geo.UserDictionary.Set("name", valName);    
    geo.UserDictionary.Set("thermalconductivity", valThermalConductivity);
    geo.UserDictionary.Set("density", valDensity);
    geo.UserDictionary.Set("heatcapacity", valSpecificHeatCapacity);
    /*
    if(bake){
    RhinoDocument.Objects.Add(geo);
    }
    */
    A = geo;
# ---------- end attachtouserdictionary_19 ----------
attachtouserdictionary_20 = CSharpScript(
    geo=brep_13,
    valName="zone_1",
    valTemp=panel_13,
    valThermalConductivity=panel_17,
    valDensity=panel_7,
    valSpecificHeatCapacity="1000")  # -> out, flatten(A); inputs geo: GeometryBase, valName: String, valType: String, valTemp: String, valThermalConductivity: String, valDensity: String, valSpecificHeatCapacity: String; same code as attachtouserdictionary_19
attachtouserdictionary_21 = CSharpScript(geo=brep_12, valName="zone_2", valThermalConductivity=panel_18, valDensity=panel_20, valSpecificHeatCapacity=panel_19)  # -> out, flatten(A); inputs geo: GeometryBase, valName: String, valType: String, valTemp: String, valThermalConductivity: String, valDensity: String, valSpecificHeatCapacity: String; same code as attachtouserdictionary_19
attachtouserdictionary_22 = CSharpScript(geo=brep_11, valName="zone_3", valThermalConductivity=panel_3, valDensity=panel_5, valSpecificHeatCapacity=panel_4)  # -> out, flatten(A); inputs geo: GeometryBase, valName: String, valType: String, valTemp: String, valThermalConductivity: String, valDensity: String, valSpecificHeatCapacity: String; same code as attachtouserdictionary_19
attachtouserdictionary_23 = CSharpScript(geo=brep_9, valName="zone_4", valThermalConductivity=panel_17, valDensity=panel_7, valSpecificHeatCapacity="1000")  # -> out, flatten(A); inputs geo: GeometryBase, valName: String, valType: String, valTemp: String, valThermalConductivity: String, valDensity: String, valSpecificHeatCapacity: String; same code as attachtouserdictionary_19
attachtouserdictionary_24 = CSharpScript(geo=brep_8, valName="zone_5", valThermalConductivity=panel_14, valDensity=panel_2, valSpecificHeatCapacity=panel)  # -> out, flatten(A); inputs geo: GeometryBase, valName: String, valType: String, valTemp: String, valThermalConductivity: String, valDensity: String, valSpecificHeatCapacity: String; same code as attachtouserdictionary_19
attachtouserdictionary_25 = CSharpScript(geo=brep_10, valName="zone_6", valThermalConductivity=panel_21, valDensity=panel_8, valSpecificHeatCapacity="1080")  # -> out, flatten(A); inputs geo: GeometryBase, valName: String, valType: String, valTemp: String, valThermalConductivity: String, valDensity: String, valSpecificHeatCapacity: String; same code as attachtouserdictionary_19
attachtouserdictionary_26 = CSharpScript(geo=brep_7, valName="zone_7", valThermalConductivity=panel_9, valDensity=panel_10, valSpecificHeatCapacity="1450")  # -> out, flatten(A); inputs geo: GeometryBase, valName: String, valType: String, valTemp: String, valThermalConductivity: String, valDensity: String, valSpecificHeatCapacity: String; same code as attachtouserdictionary_19
attachtouserdictionary_27 = CSharpScript(geo=brep_6, valName="zone_8", valThermalConductivity=panel_11, valDensity=panel_12, valSpecificHeatCapacity="1500")  # -> out, flatten(A); inputs geo: GeometryBase, valName: String, valType: String, valTemp: String, valThermalConductivity: String, valDensity: String, valSpecificHeatCapacity: String; same code as attachtouserdictionary_19
attachtouserdictionary_28 = CSharpScript(geo=brep_4, valName="zone_9", valThermalConductivity=panel_3, valDensity=panel_5, valSpecificHeatCapacity=panel_4)  # -> out, flatten(A); inputs geo: GeometryBase, valName: String, valType: String, valTemp: String, valThermalConductivity: String, valDensity: String, valSpecificHeatCapacity: String; same code as attachtouserdictionary_19
attachtouserdictionary_29 = CSharpScript(geo=brep_5, valName="zone_10", valThermalConductivity=panel_17, valDensity=panel_7, valSpecificHeatCapacity="1000")  # -> out, flatten(A); inputs geo: GeometryBase, valName: String, valType: String, valTemp: String, valThermalConductivity: String, valDensity: String, valSpecificHeatCapacity: String; same code as attachtouserdictionary_19
attachtouserdictionary_30 = CSharpScript(geo=brep_3, valName=panel_38, valThermalConductivity=panel_15, valDensity=panel_16, valSpecificHeatCapacity=panel_6)  # -> out, flatten(A); inputs geo: GeometryBase, valName: String, valType: String, valTemp: String, valThermalConductivity: String, valDensity: String, valSpecificHeatCapacity: String; same code as attachtouserdictionary_19

panel_39 = Panel([panel_38, "zone_10", "zone_9", "zone_0", "zone_1", "zone_2", "zone_3", "zone_4", "zone_5", "zone_6", "zone_7", "zone_8"])

# ----
# Normal vectors
# (slow)
# Extract orthogonality
allgeo = Geometry([attachtouserdictionary_19.A, attachtouserdictionary_20.A, attachtouserdictionary_21.A, attachtouserdictionary_22.A, attachtouserdictionary_23.A, attachtouserdictionary_24.A, attachtouserdictionary_25.A, attachtouserdictionary_26.A, attachtouserdictionary_27.A, attachtouserdictionary_28.A, attachtouserdictionary_17.A, attachtouserdictionary_18.A, attachtouserdictionary_29.A, attachtouserdictionary_30.A])
Y = UnitY(Factor=1)
Y_2 = UnitY(Factor=1)
X = UnitX(Factor=1)
X_2 = UnitX(Factor=1)
Z = UnitZ(Factor=1)
Z_2 = UnitZ(Factor=1)
debrep = DeconstructBrep(Brep=allgeo)  # -> Faces, Edges, Vertices
brep_15 = Brep(debrep.Faces)
facen = FaceNormals(Mesh=brep_15)  # -> Centers, unitize(flatten(Normals))
extractorthogonalfaces = ExtractOrthogonalFaces(B=allgeo, B_2=Y_2, B_3="1")
extractorthogonalfaces_2 = ExtractOrthogonalFaces(B=allgeo, B_2=Y, B_3="-1")
extractorthogonalfaces_3 = ExtractOrthogonalFaces(B=allgeo, B_2=X, B_3="-1")
extractorthogonalfaces_4 = ExtractOrthogonalFaces(B=allgeo, B_2=X_2, B_3="1")
extractorthogonalfaces_5 = ExtractOrthogonalFaces(B=allgeo, B_2=Z, B_3="1")
extractorthogonalfaces_6 = ExtractOrthogonalFaces(B=allgeo, B_2=Z_2, B_3="-1")
vdis = VectorDisplay(Anchor=facen.Centers, Vector=facen.Normals)  # disabled
mesh = Mesh(extractorthogonalfaces_2)
mesh_2 = Mesh(extractorthogonalfaces_3)
mesh_3 = Mesh(extractorthogonalfaces)
mesh_4 = Mesh(extractorthogonalfaces_4)
mesh_5 = Mesh(extractorthogonalfaces_5)
mesh_6 = Mesh(extractorthogonalfaces_6)
geo_17 = Geometry([mesh_2, mesh_4])
attachtouserdictionary_31 = CSharpScript(geo=geo_17, valName="frontAndBack", valType="empty")  # -> out, flatten(A); inputs bake: Boolean, geo: GeometryBase, valName: String, valType: String, valTemp: String; same code as attachtouserdictionary

data = Data([attachtouserdictionary_14.A, attachtouserdictionary_16.A, attachtouserdictionary_15.A, attachtouserdictionary_10.A, attachtouserdictionary_13.A, attachtouserdictionary_11.A, attachtouserdictionary_12.A, attachtouserdictionary_9.A, attachtouserdictionary_8.A, attachtouserdictionary_6.A, attachtouserdictionary_7.A, attachtouserdictionary_4.A, attachtouserdictionary_3.A, attachtouserdictionary_5.A, attachtouserdictionary_2.A])
geometrybasetostring = CSharpScript(x=data)  # -> flatten(A); inputs x: list of GeometryBase
# ---------- geometrybasetostring: C# ----------
    var list = new List<String>();

    foreach (GeometryBase geo in x)
    {
      list.Add(geo.UserDictionary["name"].ToString());
      list.Add(geo.UserDictionary["name"].ToString().Split(new string[] { "_to_" }, StringSplitOptions.None)[1] + "_to_" + geo.UserDictionary["name"].ToString().Split(new string[] { "_to_" }, StringSplitOptions.None)[0]);
    }



    A = list;
# ---------- end geometrybasetostring ----------
panel_40 = Panel(geometrybasetostring)

boundingbox = BoundingBox(B=allgeo)  # -> pt_10, pt_9, E, V, pt_8
minx = Point(boundingbox.pt_10)
geo_18 = Geometry(boundingbox.E)
miny = Point(boundingbox.pt_10)
maxxyz = Point(boundingbox.pt_8)
minz = Point(boundingbox.pt_9)
maxz_minx = Point(boundingbox.V)
cap = CapHoles(Brep=geo_18)
debrep_2 = DeconstructBrep(Brep=cap)  # -> Faces, Edges, Vertices
geo_19 = Geometry(debrep_2.Faces)
Y_3 = UnitY(Factor=1)
Z_3 = UnitZ(Factor=1)
Z_4 = UnitZ(Factor=1)
extractorthogonalfaces_7 = ExtractOrthogonalFaces(B=geo_19, B_2=Z_3, B_3="1")
extractorthogonalfaces_8 = ExtractOrthogonalFaces(B=geo_19, B_2=Z_4, B_3="-1")
extractorthogonalfaces_9 = ExtractOrthogonalFaces(B=geo_19, B_2=Y_3, B_3="1")
extractorthogonalfaces_10 = ExtractOrthogonalFaces(B=geo_19, B_2=Y_3, B_3="-1")

# ----
# blockMesh boundaries
panel_41 = Panel("20")
tokelvin_5 = ToKelvin(A=panel_41)
tokelvin_6 = ToKelvin(A="-5")
panel_43 = Panel("0")
panel_44 = Panel(tokelvin_6)
panel_45 = Panel(tokelvin_5)
attachtouserdictionary_32 = CSharpScript(
    geo=extractorthogonalfaces_7,
    valName="top",
    valType="fixedValue",
    valTemp=panel_45,
    valThermalConductivity=panel_13,
    valDensity=panel_13,
    valSpecificHeatCapacity=panel_13)  # -> out, flatten(A); inputs geo: GeometryBase, valName: String, valType: String, valTemp: String, valThermalConductivity: String, valDensity: String, valSpecificHeatCapacity: String; same code as attachtouserdictionary_19
attachtouserdictionary_33 = CSharpScript(
    geo=extractorthogonalfaces_10,
    valName="left",
    valType="fixedValue",
    valTemp=panel_44,
    valThermalConductivity=panel_13,
    valDensity=panel_13,
    valSpecificHeatCapacity=panel_13)  # -> out, flatten(A); inputs geo: GeometryBase, valName: String, valType: String, valTemp: String, valThermalConductivity: String, valDensity: String, valSpecificHeatCapacity: String; same code as attachtouserdictionary_19
attachtouserdictionary_34 = CSharpScript(
    geo=extractorthogonalfaces_9,
    valName="right",
    valType="fixedValue",
    valTemp=panel_45,
    valThermalConductivity=panel_13,
    valDensity=panel_13,
    valSpecificHeatCapacity=panel_13)  # -> out, flatten(A); inputs geo: GeometryBase, valName: String, valType: String, valTemp: String, valThermalConductivity: String, valDensity: String, valSpecificHeatCapacity: String; same code as attachtouserdictionary_19
attachtouserdictionary_35 = CSharpScript(
    geo=extractorthogonalfaces_8,
    valName="bottom",
    valType="fixedValue",
    valTemp=panel_45,
    valThermalConductivity=panel_13,
    valDensity=panel_13,
    valSpecificHeatCapacity=panel_13)  # -> out, flatten(A); inputs geo: GeometryBase, valName: String, valType: String, valTemp: String, valThermalConductivity: String, valDensity: String, valSpecificHeatCapacity: String; same code as attachtouserdictionary_19
data_2 = Data([attachtouserdictionary_33.A, attachtouserdictionary_34.A, attachtouserdictionary_32.A, attachtouserdictionary_35.A])

# ----
# Write out  constant/thermophysicalProperties
panel_46 = Panel("""/*--------------------------------*- C++ -*----------------------------------*\
| =========                 |                                                 |
| \\      /  F ield         | OpenFOAM: The Open Source CFD Toolbox           |
|  \\    /   O peration     | Version:  2.0.0                                 |
|   \\  /    A nd           | Web:      www.OpenFOAM.com                      |
|    \\/     M anipulation  |                                                 |
\*---------------------------------------------------------------------------*/
FoamFile
{
    version     2.0;
    format      ascii;
    class       dictionary;
    object      solidThermophysicalProperties;
}
// * * * * * * * * * * * * * * * * * * * * * * * * * * * * * * * * * * * * * //
thermoType
{
    type            heSolidThermo;
    mixture         pureMixture;
    transport       constIso;
    thermo          hConst;
    equationOfState rhoConst;
    specie          specie;
    energy          sensibleEnthalpy;
}""")
# Write out  0/T
panel_47 = Panel("""/*--------------------------------*- C++ -*----------------------------------*\
| =========                 |                                                 |
| \\      /  F ield         | OpenFOAM: The Open Source CFD Toolbox           |
|  \\    /   O peration     | Version:  4.1                                   |
|   \\  /    A nd           | Web:      www.OpenFOAM.org                      |
|    \\/     M anipulation  |                                                 |
\*---------------------------------------------------------------------------*/
FoamFile
{
    version     2.0;
    format      binary;
    class       volScalarField;
    location    "0/concrete_2";
    object      T;
}
// * * * * * * * * * * * * * * * * * * * * * * * * * * * * * * * * * * * * * //

dimensions      [ 0 0 0 1 0 0 0 ];

internalField   uniform 273;""")
# Write out 0/p
panel_48 = Panel("p")
c_script = CSharpScript(path=document_path.A, head=panel_46, fileName="thermophysicalProperties")  # -> out, A; inputs path: String, head: String, data: String, fileName: String
# ---------- c_script: C# ----------
 

      String directoryPath = path + @"\constant\" ;

      if (!Directory.Exists(directoryPath))
      {
        Directory.CreateDirectory(directoryPath);
      }


      String filePath = directoryPath + @"\" + fileName;


      A = filePath;



      File.Delete(filePath);

      using(var tw = new StreamWriter(filePath)) // new StreamWriter(path, true) for append
      {
        tw.WriteLine(head);
        //tw.WriteLine(data);



        tw.WriteLine(@"");







        tw.Close();


      }
# ---------- end c_script ----------
panel_49 = Panel(c_script.out)
# docker run -v "%cd%:/home/openfoam" --entrypoint="" hfdresearch/swak4foamandpyfoam:latest-v6.0 bash -c "source /opt/openfoam6/etc/bashrc && cd /home/openfoam &&
panel_50 = Panel("docker run -v \"%cd%:/home/openfoam\" --entrypoint=\"\" hfdresearch/swak4foamandpyfoam:latest-v4.1 bash -c \"source /opt/openfoam4/etc/bashrc && cd /home/openfoam && ")

# ----
# Crossreference surfaces with zones
# Crossreference zones with zones
panel_51 = Panel("_to_")

# ----
# Write out cellSetDict
# Write out blockMeshDict
# Write out simulation files
# Write out changeDictionaryDict
# Write out controlDict
# Write out 0/zone_*/p
# Write out  0/zone_*/T
# Write out  regionProperties
# Write out  constant/zone_*/thermophysicalProperties
# Write out system\residuals
# Write out system\fvSolution
# Write out system\fvSchemes
# Write out constant\g
panel_52 = Panel("""/*--------------------------------*- C++ -*----------------------------------*\
| =========                 |                                                 |
| \\      /  F ield         | OpenFOAM: The Open Source CFD Toolbox           |
|  \\    /   O peration     | Version:  2.0.0                                 |
|   \\  /    A nd           | Web:      www.OpenFOAM.com                      |
|    \\/     M anipulation  |                                                 |
\*---------------------------------------------------------------------------*/
FoamFile
{
    version     2.0;
    format      ascii;
    class       dictionary;
    object      fvSolution;
}
// * * * * * * * * * * * * * * * * * * * * * * * * * * * * * * * * * * * * * //

   solvers
    {
        "p_rgh.*"
        {
            solver           GAMG;
            tolerance        1e-7;
            relTol           0.01;
            smoother         DIC;
            maxIter          10;
        }

         "(U|h|e|k|epsilon).*"
        {
      solver          smoothSolver;
        smoother        GaussSeidel;
        tolerance       1e-06;
        relTol          0.1;
        }
    
	
	
	
	    T
    {
/*        solver           PCG;
        preconditioner   DIC;
        tolerance        1e-06;
        relTol           0.1;
*/
       solver           GAMG;
        tolerance        1e-9;
        relTol           0.001;

        smoother         GaussSeidel;

        cacheAgglomeration true;
        nCellsInCoarsestLevel 24;
        agglomerator     faceAreaPair;
        mergeLevels      2;

        maxIter          1000;

    }

    TFinal
    {
        $T;
        tolerance        1e-09;
        relTol           0;
    }
}

PIMPLE
{
    nNonOrthogonalCorrectors 1;

	residualControl
	{
		T	1e-2;
		TFinal	1e-2;
	}
}

relaxationFactors
{
	T	0.75;
}
	

   

// ************************************************************************* //""")
number_slider = Slider(547, range=-11..1000)
geometrybasetostring_2 = CSharpScript(x=allgeo)  # -> flatten(A); inputs x: list of GeometryBase
# ---------- geometrybasetostring_2: C# ----------
    var list = new List<String>();

    foreach (GeometryBase geo in x)
    {
      list.Add(geo.UserDictionary["name"].ToString());
    }
    A = list;
# ---------- end geometrybasetostring_2 ----------
panel_53 = Panel("symmetry")
panel_54 = Panel("""/*--------------------------------*- C++ -*----------------------------------*\
| =========                 |                                                 |
| \\      /  F ield         | OpenFOAM: The Open Source CFD Toolbox           |
|  \\    /   O peration     | Version:  2.0.0                                 |
|   \\  /    A nd           | Web:      www.OpenFOAM.com                      |
|    \\/     M anipulation  |                                                 |
\*---------------------------------------------------------------------------*/
FoamFile
{
    version     2.0;
    format      ascii;
    class       dictionary;
    object      changeDictionaryDict;
}
// * * * * * * * * * * * * * * * * * * * * * * * * * * * * * * * * * * * * * //""")
panel_55 = Panel("""/*--------------------------------*- C++ -*----------------------------------*\
| =========                 |                                                 |
| \\      /  F ield         | OpenFOAM: The Open Source CFD Toolbox           |
|  \\    /   O peration     | Version:  2.0.0                                 |
|   \\  /    A nd           | Web:      www.OpenFOAM.com                      |
|    \\/     M anipulation  |                                                 |
\*---------------------------------------------------------------------------*/
FoamFile
{
    version     2.0;
    format      ascii;
    class       dictionary;
    object      solidThermophysicalProperties;
}
// * * * * * * * * * * * * * * * * * * * * * * * * * * * * * * * * * * * * * //
thermoType
{
    type            heSolidThermo;
    mixture         pureMixture;
    transport       constIso;
    thermo          hConst;
    equationOfState rhoConst;
    specie          specie;
    energy          sensibleEnthalpy;
}""")
blockmeshdict = CSharpScript(
    zone=geo_18,
    xCells=Slider(1, range=0..10),
    yCells=number_slider,
    zCells=number_slider,
    name1="left",
    type1="patch",
    name2="right",
    type2="patch",
    name3="top",
    type3="patch",
    name4="bottom",
    type4="patch")  # -> out, blockMeshDict; inputs zone: Brep, xCells: Int32, yCells: Int32, zCells: Int32, name1: String, name2: String, name3: String, name4: String
# ---------- blockmeshdict: C# ----------
    //var output = new List<String>();

    System.Text.StringBuilder sb = new System.Text.StringBuilder();

    sb.Append(@"
      /*--------------------------------*- C++ -*----------------------------------*\
      |       o          |                                                          |
      |    o     o       | HELYX-OS                                                  |
      |   o   O   o      | Version: v2.2.0                                           |
      |    o     o       | Web:     http://www.engys.com                            |
      |       o          |                                                          |
      \*---------------------------------------------------------------------------*/
      FoamFile
      {
      version 2.0;
      format ascii;
      class dictionary;
      location system;
      object blockMeshDict;
      }
      convertToMeters 1;
      backgroundMesh
      {
      xMin " + returnMinEdge(zone.DuplicateVertices()).X +@";
      xMax " + returnMaxEdge(zone.DuplicateVertices()).X +@";
      yMin " + returnMinEdge(zone.DuplicateVertices()).Y +@";
      yMax " + returnMaxEdge(zone.DuplicateVertices()).Y +@";
      zMin " + returnMinEdge(zone.DuplicateVertices()).Z +@";
      zMax " + returnMaxEdge(zone.DuplicateVertices()).Z +@";
      xCells " + xCells +@";
      yCells " + yCells +@";
      zCells " + zCells +@";
      }
      vertices
      (
      ($:backgroundMesh.xMin $:backgroundMesh.yMin $:backgroundMesh.zMin)
      ($:backgroundMesh.xMax $:backgroundMesh.yMin $:backgroundMesh.zMin)
      ($:backgroundMesh.xMax $:backgroundMesh.yMax $:backgroundMesh.zMin)
      ($:backgroundMesh.xMin $:backgroundMesh.yMax $:backgroundMesh.zMin)
      ($:backgroundMesh.xMin $:backgroundMesh.yMin $:backgroundMesh.zMax)
      ($:backgroundMesh.xMax $:backgroundMesh.yMin $:backgroundMesh.zMax)
      ($:backgroundMesh.xMax $:backgroundMesh.yMax $:backgroundMesh.zMax)
      ($:backgroundMesh.xMin $:backgroundMesh.yMax $:backgroundMesh.zMax)
      );
      blocks
      (
      hex (0 1 2 3 4 5 6 7)
      (
      $:backgroundMesh.xCells
      $:backgroundMesh.yCells
      $:backgroundMesh.zCells
      )
      simpleGrading (1 1 1)
      );
      edges
      (
      );
      boundary
      (
      " + name1 +@"
      {
      type " + type1 +@";
      faces
      (
      (0 1 4 5)
      );
      }
      " + name2 +@"
      {
      type " + type2 +@";
      faces
      (
      (2 3 6 7)
      );
      }
      " + name4 +@"
      {
      type " + type4 +@";
      faces
      (
      (0 1 2 3)
      );
      }
      frontAndBack
      {
      type empty;
      faces
      (
      (1 2 5 6)
      (0 3 4 7)
      );
      }
      " + name3 +@"
      {
      type " + type3 +@";
      faces
      (
      (4 5 6 7)
      );
      }


      );
      ");

    blockMeshDict = sb.ToString();
# ---------- blockmeshdict: C# additional code ----------
  public Point3d returnMinEdge(Point3d[] points){

    Point3d min = points[0];

    for (int i = 0; i < points.Count(); i++){
      if (points[i].X <= min.X && points[i].Y <= min.Y && points[i].Z <= min.Z )
      {
        min = points[i];
      }
    }

    return min;
  }

  public Point3d returnMaxEdge(Point3d[] points){

    Point3d max = points[0];

    for (int i = 0; i < points.Count(); i++){
      if (points[i].X >= max.X && points[i].Y >= max.Y && points[i].Z >= max.Z )
      {
        max = points[i];
      }
    }

    return max;
  }
# ---------- end blockmeshdict ----------
panel_56 = Panel("""/*--------------------------------*- C++ -*----------------------------------*\
| =========                 |                                                 |
| \\      /  F ield         | OpenFOAM: The Open Source CFD Toolbox           |
|  \\    /   O peration     | Version:  4.1                                   |
|   \\  /    A nd           | Web:      www.OpenFOAM.org                      |
|    \\/     M anipulation  |                                                 |
\*---------------------------------------------------------------------------*/
FoamFile
{
    version     2.0;
    format      binary;
    class       volScalarField;
    location    "0/concrete_2";
    object      T;
}
// * * * * * * * * * * * * * * * * * * * * * * * * * * * * * * * * * * * * * //

dimensions      [ 0 0 0 1 0 0 0 ];

internalField   uniform 273;""")
panel_57 = Panel(geometrybasetostring_2)
panel_58 = Panel("""/*--------------------------------*- C++ -*----------------------------------*\
| =========                 |                                                 |
| \\      /  F ield         | OpenFOAM: The Open Source CFD Toolbox           |
|  \\    /   O peration     | Version:  2.0.0                                 |
|   \\  /    A nd           | Web:      www.OpenFOAM.com                      |
|    \\/     M anipulation  |                                                 |
\*---------------------------------------------------------------------------*/
FoamFile
{
    version     2.0;
    format      ascii;
    class       dictionary;
    location    "constant";
    object      regionProperties;
}
// * * * * * * * * * * * * * * * * * * * * * * * * * * * * * * * * * * * * * //""")
panel_59 = Panel("""/*--------------------------------*- C++ -*----------------------------------*\
| =========                 |                                                 |
| \\      /  F ield         | OpenFOAM: The Open Source CFD Toolbox           |
|  \\    /   O peration     | Version:  2.0.0                                 |
|   \\  /    A nd           | Web:      www.OpenFOAM.com                      |
|    \\/     M anipulation  |                                                 |
\*---------------------------------------------------------------------------*/
FoamFile
{
    version     2.0;
    format      ascii;
    class       dictionary;
    object      fvSchemes;
}
// * * * * * * * * * * * * * * * * * * * * * * * * * * * * * * * * * * * * * //

ddtSchemes
{
    default         steadyState;
}

gradSchemes
{
    default         Gauss linear;
}

divSchemes
{
    default         none;
}

laplacianSchemes
{
    default         none;
    laplacian(K,T)   Gauss linear limited 0.333;
	laplacian(alpha,h) Gauss linear limited 0.333;
}

interpolationSchemes
{
    default         linear;
}

snGradSchemes
{
    default         limited 0.333;
}

fluxRequired
{
    default         no;
}

// ************************************************************************* //""")
panel_60 = Panel(blockmeshdict.blockMeshDict)
cellsetdict = CSharpScript(names=panel_57, zones=allgeo)  # -> out, cellSet; inputs names: list of String, zones: list of Brep
# ---------- cellsetdict: C# ----------
    //var output = new List<String>();

    System.Text.StringBuilder sb = new System.Text.StringBuilder();

    for (int i = 0; i < zones.Count(); i++)
    {

      sb.Append("cellSet " + names[i] + " new boxToCell (" + returnMinEdge(zones[i].DuplicateVertices()).X + " " + returnMinEdge(zones[i].DuplicateVertices()).Y
        + " " + returnMinEdge(zones[i].DuplicateVertices()).Z + ")	(" + returnMaxEdge(zones[i].DuplicateVertices()).X + " " + returnMaxEdge(zones[i].DuplicateVertices()).Y + " " + returnMaxEdge(zones[i].DuplicateVertices()).Z + ")");
      sb.Append("\n");
      sb.Append("cellZoneSet " + names[i] + " new setToCellZone " + names[i]);
      sb.Append("\n");
      sb.Append("\n");

      //
    }


    cellSet_ = sb.ToString();
# ---------- cellsetdict: C# additional code ----------
  public Point3d returnMinEdge(Point3d[] points){

    Point3d min = points[0];

    for (int i = 0; i < points.Length; i++){
      if (points[i].X <= min.X && points[i].Y <= min.Y && points[i].Z <= min.Z )
      {
        min = points[i];
      }
    }

    return min;
  }

  public Point3d returnMaxEdge(Point3d[] points){

    Point3d max = points[0];

    for (int i = 0; i < points.Length; i++){
      if (points[i].X >= max.X && points[i].Y >= max.Y && points[i].Z >= max.Z )
      {
        max = points[i];
      }
    }

    return max;
  }
# ---------- end cellsetdict ----------
c_script_2 = CSharpScript(path=document_path.A, head=panel_58, fileName="regionProperties", zoneNames=panel_57)  # -> out, A; inputs path: String, head: String, data: String, fileName: String, zoneNames: list of String
# ---------- c_script_2: C# ----------
    foreach (String zoneName in zoneNames){



      String directoryPath = path + @"\constant\";

      if (!Directory.Exists(directoryPath))
      {
        Directory.CreateDirectory(directoryPath);
      }


      String filePath = directoryPath + @"\" + fileName;


      A = filePath;



      File.Delete(filePath);

      using(var tw = new StreamWriter(filePath)) // new StreamWriter(path, true) for append
      {
        tw.WriteLine(head);
        //tw.WriteLine(data);



        tw.WriteLine(@"regions (
          fluid ( )
          solid (");


        foreach (String str in zoneNames)
        {

          tw.Write(str + " ");



        }

        tw.WriteLine(")");
        tw.WriteLine(");");



        tw.Close();


      }





    }
# ---------- end c_script_2 ----------
concat = Concatenate(FragmentA=document_path.A, FragmentB="\system\residuals_")
c_script_3 = CSharpScript(path=document_path.A, head=panel_55, fileName="thermophysicalProperties", zoneObjects=allgeo)  # -> out, A; inputs path: String, head: String, data: String, fileName: String, zoneObjects: list of GeometryBase
# ---------- c_script_3: C# ----------
    foreach(GeometryBase geo in zoneObjects){



      String directoryPath = path + @"\constant\" + geo.UserDictionary["name"];

      if (!Directory.Exists(directoryPath))
      {
        Directory.CreateDirectory(directoryPath);
      }


      String filePath = directoryPath + @"\" + fileName;


      A = filePath;



      File.Delete(filePath);

      using(var tw = new StreamWriter(filePath)) // new StreamWriter(path, true) for append
      {
        tw.WriteLine(head);
        //tw.WriteLine(data);



        tw.WriteLine(@"mixture
          {
          specie
          {
          molWeight   1000;
          nMoles 1;
          }

          transport
          {
          kappa   " + geo.UserDictionary["thermalconductivity"] + @";
          }");
        tw.WriteLine(@"thermodynamics
          {
          Hf      0;
          Cp     " + geo.UserDictionary["heatcapacity"] + @";
          }");
        tw.WriteLine(@"equationOfState
          {
          rho     " + geo.UserDictionary["density"] + @";
          }");
        tw.Write("}");







        tw.Close();


      }





    }
# ---------- end c_script_3 ----------
c_script_4 = CSharpScript(
    path=document_path.A,
    head=panel_54,
    fileName="changeDictionaryDict",
    zoneNames=panel_57,
    emptyPatches=attachtouserdictionary_31.A)  # -> out, A; inputs path: String, head: String, data: String, fileName: String, zoneNames: list of String, boundaryPatches: list of GeometryBase, emptyPatches: list of GeometryBase
# ---------- c_script_4: C# ----------
    foreach (String zoneName in zoneNames){



      String directoryPath = path + @"\system\" + zoneName;

      if (!Directory.Exists(directoryPath))
      {
        Directory.CreateDirectory(directoryPath);
      }


      String filePath = path + @"\system\" + zoneName + @"\" + fileName;


      A = filePath;



      File.Delete(filePath);

      using(var tw = new StreamWriter(filePath)) // new StreamWriter(path, true) for append
      {
        tw.WriteLine(head);
        tw.WriteLine(data);

        tw.WriteLine("boundary");
        tw.WriteLine("{");
        foreach (GeometryBase emptyPatch in emptyPatches)
        {

          tw.WriteLine(emptyPatch.UserDictionary["name"]);
          tw.WriteLine("{");
          tw.WriteLine("type " + emptyPatch.UserDictionary["type"] + ";");
          tw.WriteLine("}");

        }
        tw.WriteLine("}");



        tw.WriteLine("T");
        tw.WriteLine("{");
        tw.WriteLine("internalField   uniform 0;");



        //tw.WriteLine("boundaryField");
        //tw.WriteLine("{");
        tw.WriteLine(@"
          boundaryField
          {
          "".*""
          {
          type zeroGradient;
          }");

        foreach (String zN in zoneNames)
        {

          tw.WriteLine("\"" + zN +@"_to_.*""
            {
            type compressible::turbulentTemperatureCoupledBaffleMixed;
            neighbourFieldName T;
            K solidThermo;
            KName none;
            value uniform 0;
            kappaMethod solidThermo;
            Tnbr T;
            }");
        }

        foreach (GeometryBase boundaryPatch in boundaryPatches)
        {

          tw.WriteLine(boundaryPatch.UserDictionary["name"]);
          tw.WriteLine("{");
          tw.WriteLine("type " + boundaryPatch.UserDictionary["type"] + ";");
          tw.WriteLine("value uniform  " + boundaryPatch.UserDictionary["temp"] + ";");
          tw.WriteLine("}");

        }

        tw.WriteLine("}");

        tw.WriteLine("}");

        tw.Close();


      }





    }
# ---------- end c_script_4 ----------
c_script_5 = CSharpScript(path=document_path.A, fileName="system\fvSolution", zones=allgeo)  # -> out, A; inputs path: String, fileName: String, zones: list of GeometryBase
# ---------- c_script_5: C# ----------
    String filePath = path + @"\" + fileName;


    A = filePath;



    File.Delete(filePath);

    using(var tw = new StreamWriter(filePath)) // new StreamWriter(path, true) for append
    {
      tw.WriteLine(@"/*--------------------------------*- C++ -*----------------------------------*\
        | =========                 |                                                 |
        | \\      /  F ield         | OpenFOAM: The Open Source CFD Toolbox           |
        |  \\    /   O peration     | Version:  2.0.0                                 |
        |   \\  /    A nd           | Web:      www.OpenFOAM.com                      |
        |    \\/     M anipulation  |                                                 |
        \*---------------------------------------------------------------------------*/
        FoamFile
        {
        version     2.0;
        format      ascii;
        class       dictionary;
        object      fvSolution;
        }
        // * * * * * * * * * * * * * * * * * * * * * * * * * * * * * * * * * * * * * //

        solvers
        {
        ""p_rgh.*""
        {
        solver GAMG;
        tolerance        1e-7;
        relTol           0.01;
        smoother DIC;
        maxIter          10;
        }

        ""(U|h|e|k|epsilon).*""
        {
        solver          smoothSolver;
        smoother        GaussSeidel;
        tolerance       1e-06;
        relTol          0.1;
        }




        T
        {
        /*        solver           PCG;
        preconditioner   DIC;
        tolerance        1e-06;
        relTol           0.1;
        */
        solver GAMG;
        tolerance        1e-9;
        relTol           0.001;

        smoother GaussSeidel;

        cacheAgglomeration true;
        nCellsInCoarsestLevel 24;
        agglomerator faceAreaPair;
        mergeLevels      2;

        maxIter          1000;

        }

        TFinal
        {
        $T;
        tolerance        1e-09;
        relTol           0;
        }

        hFinal
        {
        $h;
        tolerance        1e-09;
        relTol           0;
        }

        }

        PIMPLE
        {
        nNonOrthogonalCorrectors 1;
        momentumPredictor true;

        residualControl
        {
        T	1e-2;
        TFinal	1e-2;
        }
        }

        relaxationFactors
        {
        T	0.75;
        }




        // ************************************************************************* //

        ");


      tw.Close();


    }
# ---------- end c_script_5 ----------
concat_2 = Concatenate(FragmentA=document_path.A, FragmentB="\system\controlDict")
c_script_6 = CSharpScript(path=document_path.A, data=panel_52, fileName="fvSolution", zoneNames=panel_57)  # -> out, A; inputs path: String, head: String, data: String, fileName: String, zoneNames: list of String
# ---------- c_script_6: C# ----------
    foreach (String zoneName in zoneNames){



      String directoryPath = path + @"\system\" + zoneName;

      if (!Directory.Exists(directoryPath))
      {
        Directory.CreateDirectory(directoryPath);
      }


      String filePath = path + @"\system\" + zoneName + @"\" + fileName;


      A = filePath;


      File.Delete(filePath);
      /*
      if (!File.Exists(filePath))
      {


        //File.Create(path);
        var tw = new StreamWriter(filePath);
        tw.WriteLine(head);
        tw.WriteLine(data);
        tw.Close();
      }


      else if (File.Exists(path))*/
      {

        using(var tw = new StreamWriter(filePath)) // new StreamWriter(path, true) for append
        {

          tw.WriteLine(data);
          tw.Close();
        }
      }


    }
# ---------- end c_script_6 ----------
panel_61 = Panel(cellsetdict.cellSet)
c_script_7 = CSharpScript(path=document_path.A, fileName="constant\g", zones=allgeo)  # -> out, A; inputs path: String, fileName: String, zones: list of GeometryBase
# ---------- c_script_7: C# ----------
    String filePath = path + @"\" + fileName;


    A = filePath;



    File.Delete(filePath);

    using(var tw = new StreamWriter(filePath)) // new StreamWriter(path, true) for append
    {
      tw.WriteLine(@"/*--------------------------------*- C++ -*----------------------------------*\
        | =========                 |                                                 |
        | \\      /  F ield         | OpenFOAM: The Open Source CFD Toolbox           |
        |  \\    /   O peration     | Version:  5                                     |
        |   \\  /    A nd           | Web:      www.OpenFOAM.org                      |
        |    \\/     M anipulation  |                                                 |
        \*---------------------------------------------------------------------------*/
        FoamFile
        {
        version     2.0;
        format      ascii;
        class       uniformDimensionedVectorField;
        location    ""constant"";
      object g;
    }
    // * * * * * * * * * * * * * * * * * * * * * * * * * * * * * * * * * * * * * //

    dimensions [0 1 -2 0 0 0 0];
    value (0 0 -9.81 );

    // ************************************************************************* //



        ");


      tw.Close();


    }
# ---------- end c_script_7 ----------
panel_62 = Panel(c_script_3.out)
c_script_8 = CSharpScript(path=concat, zoneNames=panel_39)  # -> out, A; inputs path: String, zoneNames: list of String
# ---------- c_script_8: C# ----------
    foreach(string z in zoneNames){

      using(var tw = new StreamWriter(path + z)) // new StreamWriter(path, true) for append
      {


        tw.WriteLine(@"
          type     residuals;
          libs    (""libutilityFunctionObjects.so"");
          writeControl timeStep;
          writeInterval   1;
          regionType all;
          region " + z + @";
          fields (h);
          ");
        tw.Close();
      }




    }
# ---------- end c_script_8 ----------
c_script_9 = CSharpScript(path=concat_2, zoneNames=panel_39)  # -> out, A; inputs path: String, zoneNames: list of String
# ---------- c_script_9: C# ----------
    using(var tw = new StreamWriter(path)) // new StreamWriter(path, true) for append
    {
      tw.WriteLine(@"

        /*--------------------------------*- C++ -*----------------------------------*\
        | =========                 |                                                 |
        | \\      /  F ield         | OpenFOAM: The Open Source CFD Toolbox           |
        |  \\    /   O peration     | Version:  2.0.0                                 |
        |   \\  /    A nd           | Web:      www.OpenFOAM.com                      |
        |    \\/     M anipulation  |                                                 |
        \*---------------------------------------------------------------------------*/
        FoamFile
        {
        version     2.0;
        format      ascii;
        class       dictionary;
        location    ""system"";
        object controlDict;
        }
        // * * * * * * * * * * * * * * * * * * * * * * * * * * * * * * * * * * * * * //

        application chtMultiRegionFoam;

        startFrom latestTime;

        startTime       0;

        stopAt endTime;
        //stopAt          writeNow;

        endTime         140;

        deltaT          1;

        writeControl adjustableRunTime;

        writeInterval   20;

        purgeWrite      0;

        writeFormat binary;
        //writeFormat     ascii;

        writePrecision  8;

        writeCompression off;
        //writeCompression on;

        timeFormat general;

        timePrecision   6;

        runTimeModifiable no;

        //maxCo           0.3;

        // Maximum diffusion number
        //maxDi           2.0;

        adjustTimeStep no;

        functions
        {");



      foreach(string z in zoneNames){
        tw.WriteLine("#includeFunc residuals_" + z);

      }



      tw.WriteLine(@"};




        ");
      tw.Close();
    }
# ---------- end c_script_9 ----------
c_script_10 = CSharpScript(path=document_path.A, fileName="system\fvSchemes", zones=allgeo)  # -> out, A; inputs path: String, fileName: String, zones: list of GeometryBase
# ---------- c_script_10: C# ----------
    String filePath = path + @"\" + fileName;


    A = filePath;



    File.Delete(filePath);

    using(var tw = new StreamWriter(filePath)) // new StreamWriter(path, true) for append
    {
      tw.WriteLine(@"/*--------------------------------*- C++ -*----------------------------------*\
        | =========                 |                                                 |
        | \\      /  F ield         | OpenFOAM: The Open Source CFD Toolbox           |
        |  \\    /   O peration     | Version:  2.0.0                                 |
        |   \\  /    A nd           | Web:      www.OpenFOAM.com                      |
        |    \\/     M anipulation  |                                                 |
        \*---------------------------------------------------------------------------*/
        FoamFile
        {
        version     2.0;
        format      ascii;
        class       dictionary;
        object      fvSchemes;
        }
        // * * * * * * * * * * * * * * * * * * * * * * * * * * * * * * * * * * * * * //

        ddtSchemes
        {
        default         steadyState;
        }

        gradSchemes
        {
        default         Gauss linear;
        }

        divSchemes
        {
        default         none;
        }

        laplacianSchemes
        {
        default         none;
        laplacian(K,T)   Gauss linear limited 0.333;
        laplacian(alpha,h) Gauss linear limited 0.333;
        }

        interpolationSchemes
        {
        default         linear;
        }

        snGradSchemes
        {
        default         limited 0.333;
        }

        fluxRequired
        {
        default         no;
        }

        // ************************************************************************* //

        ");


      tw.Close();


    }
# ---------- end c_script_10 ----------
concat_3 = Concatenate(FragmentA=document_path.A, FragmentB="\system\blockMeshDict")
concat_4 = Concatenate(FragmentA=document_path.A, FragmentB="\system\cellSetDict")
c_script_11 = CSharpScript(path=concat_4, data=panel_61)  # -> out, A; inputs path: String, head: String, data: String
# ---------- c_script_11: C# ----------
    if (!File.Exists(path))
    {
      //File.Create(path);
      var tw = new StreamWriter(path);
      tw.WriteLine(head);
      tw.WriteLine(data);
      tw.Close();
    }
    else if (File.Exists(path))
    {
      using(var tw = new StreamWriter(path))
      {
        tw.WriteLine(data);
        tw.Close();
      }
    }
# ---------- end c_script_11 ----------
c_script_12 = CSharpScript(path=document_path.A, data=panel_59, fileName="fvSchemes", zoneNames=panel_57)  # -> out, A; inputs path: String, head: String, data: String, fileName: String, zoneNames: list of String; same code as c_script_6
c_script_13 = CSharpScript(path=concat_3, data=panel_60)  # -> out, A; inputs path: String, head: String, data: String
# ---------- c_script_13: C# ----------
    if (!File.Exists(path))
    {
      //File.Create(path);
      var tw = new StreamWriter(path);
      tw.WriteLine(head);
      tw.WriteLine(data);
      tw.Close();
    }
    else if (File.Exists(path))
    {
      using(var tw = new StreamWriter(path)) // new StreamWriter(path, true) for append
      {
        tw.WriteLine(data);
        tw.Close();
      }
    }
# ---------- end c_script_13 ----------

crossref = CrossReference(ListA=panel_57, ListB=panel_57, CrossMode=1)  # -> ListA, ListB
crossref_2 = CrossReference(ListA=["right", "top", "bottom", "left"], ListB=panel_57, CrossMode=1)  # -> ListA, ListB
panel_63 = Panel(crossref.ListA)
panel_64 = Panel(crossref.ListB)
panel_65 = Panel(crossref_2.ListA)
panel_66 = Panel(crossref_2.ListA)
panel_67 = Panel(crossref_2.ListB)
panel_68 = Panel(crossref_2.ListB)
concat_5 = Concatenate(FragmentA=panel_63, FragmentB=panel_51, FragmentC=panel_64)
panel_69 = Panel(concat_5)
concat_6 = Concatenate(FragmentA=panel_67, FragmentC="_to_", FragmentB=panel_66)
concat_7 = Concatenate(FragmentA=panel_65, FragmentC="_to_", FragmentB=panel_68)
data_3 = Data(flatten([concat_6, concat_7, concat_5]))
c_script_14 = CSharpScript(
    allPossibleCombinations=data_3,
    boundaries=panel_40,
    Reference=["C:\Windows\Microsoft.NET\Framework64\v4.0.30319\System.Linq.dll", "C:\Windows\Microsoft.NET\Framework64\v4.0.30319\System.Linq.Expressions.dll", "C:\Windows\Microsoft.NET\Framework64\v4.0.30319\System.Linq.Parallel.dll"])  # -> A; inputs allPossibleCombinations: list of String, boundaries: list of String
# ---------- c_script_14: C# usings ----------
using System.Linq;
# ---------- c_script_14: C# ----------
    //bool containsCommonItem = list.Any(x => list2.Contains(x));




    bool[] outputList = new bool[allPossibleCombinations.Count];

    for  (int i = 0 ; i < allPossibleCombinations.Count ; i++){
      if( boundaries.IndexOf(allPossibleCombinations[i]) >= 0 )
      {
        outputList[allPossibleCombinations.IndexOf(allPossibleCombinations[i])] = false;
      }
      else{
        outputList[allPossibleCombinations.IndexOf(allPossibleCombinations[i])] = true;
      }
    }






    A = outputList;
# ---------- end c_script_14 ----------
panel_70 = Panel(data_3)
cull = CullPattern(List=panel_70, CullPattern=c_script_14)
panel_71 = Panel(cull)

c_script_15 = CSharpScript(
    path=document_path.A,
    head=panel_54,
    fileName="p",
    zoneNames=panel_57,
    emptyPatches=attachtouserdictionary_31.A,
    remainingPatches=panel_71)  # -> out, A; inputs path: String, head: String, data: String, fileName: String, zoneNames: list of String, boundaryPatches: list of GeometryBase, emptyPatches: list of GeometryBase, remainingPatches: list of String
# ---------- c_script_15: C# ----------
    foreach (String zoneName in zoneNames){



      String directoryPath = path + @"\0\" + zoneName;

      if (!Directory.Exists(directoryPath))
      {
        Directory.CreateDirectory(directoryPath);
      }


      String filePath = directoryPath + @"\" + fileName;


      A = filePath;



      File.Delete(filePath);

      using(var tw = new StreamWriter(filePath)) // new StreamWriter(path, true) for append
      {
        tw.WriteLine(head);
        tw.WriteLine(data);

        tw.WriteLine("dimensions [1 -1 -2 0 0 0 0];");

        tw.WriteLine("internalField uniform 100000;");




        /*foreach (GeometryBase emptyPatch in emptyPatches)
        {

          tw.WriteLine(emptyPatch.UserDictionary["name"]);
          tw.WriteLine("{");
          tw.WriteLine("type calculated;");
          tw.WriteLine("value $internalField;");
          tw.WriteLine("}");

        }
        foreach (String str in remainingPatches)
        {

          tw.WriteLine(str);
          tw.WriteLine("{");
          tw.WriteLine("type calculated;");
          tw.WriteLine("value $internalField;");
          tw.WriteLine("}");

        }

        tw.WriteLine("}");*/

        tw.WriteLine("boundaryField");
        tw.WriteLine("{");
        tw.WriteLine("\".*\"");
        tw.WriteLine("{");
        tw.WriteLine("type calculated;");
        tw.WriteLine("value $internalField;");
        tw.WriteLine("}");
        tw.WriteLine("}");


        tw.Close();


      }





    }
# ---------- end c_script_15 ----------
c_script_16 = CSharpScript(
    path=document_path.A,
    head=panel_56,
    fileName="T",
    zoneNames=panel_57,
    crossRefZoneNames=panel_71,
    actualBoundaries=data,
    bMBoundaries=data_2)  # -> out, A; inputs path: String, head: String, data: String, fileName: String, zoneNames: list of String, crossRefZoneNames: list of String, actualBoundaries: list of GeometryBase, bMBoundaries: list of GeometryBase
# ---------- c_script_16: C# ----------
    foreach (String zoneName in zoneNames){



      String directoryPath = path + @"\0\" + zoneName;

      if (!Directory.Exists(directoryPath))
      {
        Directory.CreateDirectory(directoryPath);
      }


      String filePath = directoryPath + @"\" + fileName;


      A = filePath;



      File.Delete(filePath);

      using(var tw = new StreamWriter(filePath)) // new StreamWriter(path, true) for append
      {
        tw.WriteLine(head);
        tw.WriteLine(data);




        tw.WriteLine("boundaryField");
        tw.WriteLine("{");
        foreach (String str in crossRefZoneNames)
        {
          tw.WriteLine(str);
          tw.WriteLine("{");
          tw.WriteLine(@"type compressible::turbulentTemperatureCoupledBaffleMixed;
            value uniform 273;
            neighbourFieldName T;
            K solidThermo;
            KName none;
            kappaMethod solidThermo;
            Tnbr T;");
          tw.WriteLine("}");
        }
        foreach (GeometryBase geo in bMBoundaries)
        {
          tw.WriteLine(geo.UserDictionary["name"]);
          tw.WriteLine("{");
          tw.WriteLine("type " + geo.UserDictionary["type"] + ";");
          tw.WriteLine("value uniform " + geo.UserDictionary["temp"] + ";");
          tw.WriteLine("}");
        }

        foreach (GeometryBase geo in actualBoundaries)
        {
          tw.WriteLine(geo.UserDictionary["name"]);
          tw.WriteLine("{");
          tw.WriteLine("type " + geo.UserDictionary["type"] + ";");
          tw.WriteLine("value uniform " + geo.UserDictionary["temp"] + ";");
          tw.WriteLine("}");
          tw.WriteLine(geo.UserDictionary["name"].ToString().Split(new string[] { "_to_" }, StringSplitOptions.None)[1] + "_to_" + geo.UserDictionary["name"].ToString().Split(new string[] { "_to_" }, StringSplitOptions.None)[0]);
          tw.WriteLine("{");
          tw.WriteLine("type " + geo.UserDictionary["type"] + ";");
          tw.WriteLine("value uniform " + geo.UserDictionary["temp"] + ";");
          tw.WriteLine("}");
        }

        tw.WriteLine("}");



        tw.Close();


      }





    }
# ---------- end c_script_16 ----------

c_script_17 = CSharpScript(
    path=document_path.A,
    head=panel_54,
    fileName=panel_48,
    emptyPatches=attachtouserdictionary_31.A,
    remainingPatches=panel_71)  # -> out, A; inputs path: String, head: String, data: String, fileName: String, boundaryPatches: list of GeometryBase, emptyPatches: list of GeometryBase, remainingPatches: list of String
# ---------- c_script_17: C# ----------
      String directoryPath = path + @"\0\" ;

      if (!Directory.Exists(directoryPath))
      {
        Directory.CreateDirectory(directoryPath);
      }


      String filePath = directoryPath + @"\" + fileName;


      A = filePath;



      File.Delete(filePath);

      using(var tw = new StreamWriter(filePath)) // new StreamWriter(path, true) for append
      {
        tw.WriteLine(head);
        tw.WriteLine(data);

        tw.WriteLine("dimensions [1 -1 -2 0 0 0 0];");

        tw.WriteLine("internalField uniform 100000;");




        /*foreach (GeometryBase emptyPatch in emptyPatches)
        {

          tw.WriteLine(emptyPatch.UserDictionary["name"]);
          tw.WriteLine("{");
          tw.WriteLine("type calculated;");
          tw.WriteLine("value $internalField;");
          tw.WriteLine("}");

        }
        foreach (String str in remainingPatches)
        {

          tw.WriteLine(str);
          tw.WriteLine("{");
          tw.WriteLine("type calculated;");
          tw.WriteLine("value $internalField;");
          tw.WriteLine("}");

        }

        tw.WriteLine("}");*/

        tw.WriteLine("boundaryField");
        tw.WriteLine("{");
        tw.WriteLine("\".*\"");
        tw.WriteLine("{");
        tw.WriteLine("type calculated;");
        tw.WriteLine("value $internalField;");
        tw.WriteLine("}");
        tw.WriteLine("}");


        tw.Close();


     





    }
# ---------- end c_script_17 ----------
c_script_18 = CSharpScript(
    path=document_path.A,
    head=panel_47,
    fileName="T",
    crossRefZoneNames=panel_71,
    actualBoundaries=data,
    bMBoundaries=data_2)  # -> out, A; inputs path: String, head: String, data: String, fileName: String, crossRefZoneNames: list of String, actualBoundaries: list of GeometryBase, bMBoundaries: list of GeometryBase
# ---------- c_script_18: C# ----------
    String directoryPath = path + @"\0\";

    if (!Directory.Exists(directoryPath))
    {
      Directory.CreateDirectory(directoryPath);
    }


    String filePath = directoryPath + @"\" + fileName;


    A = filePath;



    File.Delete(filePath);

    using(var tw = new StreamWriter(filePath)) // new StreamWriter(path, true) for append
    {
      tw.WriteLine(head);
      tw.WriteLine(data);




      tw.WriteLine("boundaryField");
      tw.WriteLine("{");
      foreach (String str in crossRefZoneNames)
      {
        tw.WriteLine(str);
        tw.WriteLine("{");
        tw.WriteLine(@"type compressible::turbulentTemperatureCoupledBaffleMixed;
          value uniform 273;
          neighbourFieldName T;
          K solidThermo;
          KName none;
          kappaMethod solidThermo;
          Tnbr T;");
        tw.WriteLine("}");
      }
      foreach (GeometryBase geo in bMBoundaries)
      {
        tw.WriteLine(geo.UserDictionary["name"]);
        tw.WriteLine("{");
        tw.WriteLine("type " + geo.UserDictionary["type"] + ";");
        tw.WriteLine("value uniform " + geo.UserDictionary["temp"] + ";");
        tw.WriteLine("}");
      }

      foreach (GeometryBase geo in actualBoundaries)
      {
        tw.WriteLine(geo.UserDictionary["name"]);
        tw.WriteLine("{");
        tw.WriteLine("type " + geo.UserDictionary["type"] + ";");
        tw.WriteLine("value uniform " + geo.UserDictionary["temp"] + ";");
        tw.WriteLine("}");
        tw.WriteLine(geo.UserDictionary["name"].ToString().Split(new string[] { "_to_" }, StringSplitOptions.None)[1] + "_to_" + geo.UserDictionary["name"].ToString().Split(new string[] { "_to_" }, StringSplitOptions.None)[0]);
        tw.WriteLine("{");
        tw.WriteLine("type " + geo.UserDictionary["type"] + ";");
        tw.WriteLine("value uniform " + geo.UserDictionary["temp"] + ";");
        tw.WriteLine("}");
      }

      tw.WriteLine("}");



      tw.Close();








    }
# ---------- end c_script_18 ----------

# ----
# Write out run_changeDicts.bat
# Write out heatflux.bat
# Write out  run_plot.bat
# Write out  plot_residuals.bat
# Write out  run_chtMultiRegionFoam.bat
# Write out  blockMesh.bat
# Write out  run_cellSet.bat
# Write out  run_splitMesh.bat
# Write out run_all.bat
panel_72 = Panel("run_heatflux.bat")
panel_73 = Panel("run_splitMesh.bat")  # disabled
panel_74 = Panel("run_plot.bat")  # disabled
panel_75 = Panel("run_blockMesh.bat")  # disabled
panel_76 = Panel("run_cellSet.bat")  # disabled
panel_77 = Panel("run_all.bat")  # disabled
panel_78 = Panel("run_chtMultiRegionFoam.bat")  # disabled
panel_79 = Panel("plot_residuals.bat")  # disabled
# BlueCFD (currently not working for some reason)
panel_80 = Panel("run_changeDicts.bat")  # disabled
c_script_19 = CSharpScript(path=document_path.A, fileName=panel_74, zones=allgeo)  # -> out, A; inputs path: String, fileName: String, zones: list of GeometryBase; disabled
# ---------- c_script_19: C# ----------
    String filePath = path + @"\" + fileName;


    A = filePath;



    File.Delete(filePath);

    using(var tw = new StreamWriter(filePath)) // new StreamWriter(path, true) for append
    {


      tw.WriteLine(string.Format(@"setlocal"));
      tw.WriteLine(string.Format(@"call ""C:\Program Files\blueCFD-Core-2017\\setvars.bat"""));
      tw.WriteLine(@"set PATH=%HOME%\msys64\usr\bin;%PATH%");
      tw.WriteLine(@"cd /d %~dp0");


      foreach(GeometryBase geo in zones){
        tw.Write(@"postProcess -func graph_220 -latestTime -region " + geo.UserDictionary["name"] + "; ");
        tw.Write(@"postProcess -func graph_158 -latestTime -region " + geo.UserDictionary["name"] + "; ");
      }





      tw.Write("\"");
      tw.WriteLine("\n");
    //  tw.WriteLine("PAUSE");


      tw.Close();


    }
# ---------- end c_script_19 ----------
c_script_20 = CSharpScript(path=document_path.A, fileName=panel_75, zones=allgeo)  # -> out, A; inputs path: String, fileName: String, zones: list of GeometryBase; disabled
# ---------- c_script_20: C# ----------
    String filePath = path + @"\" + fileName;


    A = filePath;

 


    File.Delete(filePath);

    using(var tw = new StreamWriter(filePath)) // new StreamWriter(path, true) for append
    {
      tw.WriteLine(string.Format(@"setlocal"));
      tw.WriteLine(string.Format(@"call ""C:\Program Files\blueCFD-Core-2020\\setvars_OF8.bat"""));
      tw.WriteLine(@"set PATH=%HOME%\msys64\usr\bin;%PATH%");
      tw.WriteLine(@"cd /d %~dp0");
      tw.Write(@"blockMesh");






      //tw.Write("\"");
      tw.WriteLine("\n");
      //tw.WriteLine("PAUSE");


      tw.Close();


    }
# ---------- end c_script_20 ----------
c_script_21 = CSharpScript(path=document_path.A, fileName=panel_73, zones=allgeo)  # -> out, A; inputs path: String, fileName: String, zones: list of GeometryBase; disabled
# ---------- c_script_21: C# ----------
    String filePath = path + @"\" + fileName;


    A = filePath;



    File.Delete(filePath);

    using(var tw = new StreamWriter(filePath)) // new StreamWriter(path, true) for append
    {
      tw.WriteLine(string.Format(@"setlocal"));
      tw.WriteLine(string.Format(@"call ""C:\Program Files\blueCFD-Core-2020\\setvars_OF8.bat"""));
      tw.WriteLine(@"set PATH=%HOME%\msys64\usr\bin;%PATH%");
      tw.WriteLine(@"cd /d %~dp0");
      tw.Write(@"splitMeshRegions -cellZones -overwrite");






      //tw.Write("\"");
      tw.WriteLine("\n");
      // tw.WriteLine("PAUSE");


      tw.Close();


    }
# ---------- end c_script_21 ----------
c_script_22 = CSharpScript(path=document_path.A, fileName=panel_78, zones=allgeo)  # -> out, A; inputs path: String, fileName: String, zones: list of GeometryBase; disabled
# ---------- c_script_22: C# ----------
    String filePath = path + @"\" + fileName;


    A = filePath;



    File.Delete(filePath);

    using(var tw = new StreamWriter(filePath)) // new StreamWriter(path, true) for append
    {
      tw.WriteLine(string.Format(@"setlocal"));
      tw.WriteLine(string.Format(@"call ""C:\Program Files\blueCFD-Core-2020\\setvars_OF8.bat"""));
      tw.WriteLine(@"set PATH=%HOME%\msys64\usr\bin;%PATH%");
      tw.WriteLine(@"cd /d %~dp0");


      tw.Write(@"chtMultiRegionFoam");






      //tw.Write("\"");
      tw.WriteLine("\n");
      // tw.WriteLine("PAUSE");


      tw.Close();


    }
# ---------- end c_script_22 ----------
c_script_23 = CSharpScript(path=document_path.A, fileName=panel_76, zones=allgeo)  # -> out, A; inputs path: String, fileName: String, zones: list of GeometryBase; disabled
# ---------- c_script_23: C# ----------
    String filePath = path + @"\" + fileName;


    A = filePath;



    File.Delete(filePath);

    using(var tw = new StreamWriter(filePath)) // new StreamWriter(path, true) for append
    {
      tw.WriteLine(string.Format(@"setlocal"));
      tw.WriteLine(string.Format(@"call ""C:\Program Files\blueCFD-Core-2020\\setvars_OF8.bat"""));
      tw.WriteLine(@"set PATH=%HOME%\msys64\usr\bin;%PATH%");
      tw.WriteLine(@"cd /d %~dp0");
      tw.Write(@"setSet -batch system\cellSetDict");






      //tw.Write("\"");
      tw.WriteLine("\n");
      //tw.WriteLine("PAUSE");


      tw.Close();


    }
# ---------- end c_script_23 ----------
c_script_24 = CSharpScript(path=document_path.A, fileName=panel_79, zones=allgeo)  # -> out, A; inputs path: String, fileName: String, zones: list of GeometryBase; disabled
# ---------- c_script_24: C# ----------
    String filePath = path + @"\" + fileName;


    A = filePath;



    File.Delete(filePath);

    using(var tw = new StreamWriter(filePath)) // new StreamWriter(path, true) for append
    {
      tw.Write(@"gnuplot residuals_template.gnu");






      tw.Write("\"");
      tw.WriteLine("\n");
      tw.WriteLine("PAUSE");


      tw.Close();


    }
# ---------- end c_script_24 ----------
c_script_25 = CSharpScript(path=document_path.A, fileName=panel_77, zones=allgeo)  # -> out, A; inputs path: String, fileName: String, zones: list of GeometryBase; disabled
# ---------- c_script_25: C# ----------
    String filePath = path + @"\" + fileName;


    A = filePath;



    File.Delete(filePath);

    using(var tw = new StreamWriter(filePath)) // new StreamWriter(path, true) for append
    {
      tw.WriteLine(@"call run_blockMesh.bat");
      tw.WriteLine(@"call run_cellSet.bat");
      tw.WriteLine(@"call run_splitMesh.bat");
      tw.WriteLine(@"call run_changeDicts.bat");
      tw.WriteLine(@"call run_chtMultiRegionFoam.bat");




      tw.Close();


    }
# ---------- end c_script_25 ----------
c_script_26 = CSharpScript(path=document_path.A, fileName=panel_72, zones=allgeo)  # -> out, A; inputs path: String, fileName: String, zones: list of GeometryBase
# ---------- c_script_26: C# ----------
    String filePath = path + @"\" + fileName;


    A = filePath;



    File.Delete(filePath);

    using(var tw = new StreamWriter(filePath)) // new StreamWriter(path, true) for append
    {
      tw.WriteLine(string.Format(@"setlocal"));
      tw.WriteLine(string.Format(@"call ""C:\Program Files\blueCFD-Core-2017\\setvars.bat"""));
      tw.WriteLine(@"set PATH=%HOME%\msys64\usr\bin;%PATH%");
      tw.WriteLine(@"cd /d %~dp0");



      foreach(GeometryBase geo in zones){
        tw.WriteLine(@"postProcess -func grad(T) -region " + geo.UserDictionary["name"]);
      }





      tw.Write("\"");
      tw.WriteLine("\n");
      tw.WriteLine("PAUSE");


      tw.Close();


    }
# ---------- end c_script_26 ----------
c_script_27 = CSharpScript(path=document_path.A, fileName=panel_80, zoneNames=panel_57)  # -> out, A; inputs path: String, fileName: String, zoneNames: list of String; disabled
# ---------- c_script_27: C# ----------
    String filePath = path + @"\" + fileName;


    A = filePath;



    File.Delete(filePath);

    using(var tw = new StreamWriter(filePath)) // new StreamWriter(path, true) for append
    {
      tw.WriteLine(string.Format(@"call ""C:\Program Files\blueCFD-Core-2020\\setvars_OF8.bat"""));
      tw.WriteLine(@"set PATH=%HOME%msys64\usr\bin;%PATH%");
      tw.WriteLine(@"cd """ + path.ToString() + @"""");

      foreach (String zoneName in zoneNames){
        tw.WriteLine(@"changeDictionary -region " + zoneName);
      }



      //tw.Write("\"");
      tw.WriteLine("\n");
      // tw.WriteLine("PAUSE");


      tw.Close();


    }
# ---------- end c_script_27 ----------

# ----
# Write out run_changeDicts.bat
# Write out heatflux.bat
# Write out  run_plot.bat
# Write out  plot_residuals.bat
# Write out  run_chtMultiRegionFoam.bat
# Write out  blockMesh.bat
# Write out  run_cellSet.bat
# Write out  run_splitMesh.bat
# Write out run_all.bat
panel_81 = Panel("run_heatflux.bat")  # disabled
# OpenFOAM via Docker
panel_82 = Panel("run_changeDicts.bat")
c_script_28 = CSharpScript(path=document_path.A, fileName="run_plot.bat", zones=allgeo, dockerCMD=panel_50)  # -> out, A; inputs path: String, fileName: String, zones: list of GeometryBase
# ---------- c_script_28: C# ----------
    String filePath = path + @"\" + fileName;


    A = filePath;



    File.Delete(filePath);

    using(var tw = new StreamWriter(filePath)) // new StreamWriter(path, true) for append
    {


      tw.Write(dockerCMD);



      foreach(GeometryBase geo in zones){
        tw.Write(@" && postProcess -func graph_220 -latestTime -region " + geo.UserDictionary["name"] + "; ");
        tw.Write(@" postProcess -func graph_158 -latestTime -region " + geo.UserDictionary["name"] + "; ");
      }





      tw.Write("\"");
      tw.WriteLine("\n");
      //  tw.WriteLine("PAUSE");


      tw.Close();


    }
# ---------- end c_script_28 ----------
c_script_29 = CSharpScript(path=document_path.A, fileName="run_blockMesh.bat", zones=allgeo, dockerCMD=panel_50)  # -> out, A; inputs path: String, fileName: String, zones: list of GeometryBase
# ---------- c_script_29: C# ----------
    String filePath = path + @"\" + fileName;


    A = filePath;




    File.Delete(filePath);

    using(var tw = new StreamWriter(filePath)) // new StreamWriter(path, true) for append
    {
      tw.Write(dockerCMD);





      tw.Write("blockMesh");
      tw.WriteLine("\n");
      //tw.WriteLine("PAUSE");


      tw.Close();


    }
# ---------- end c_script_29 ----------
c_script_30 = CSharpScript(path=document_path.A, fileName="run_splitMesh.bat", zones=allgeo, dockerCMD=panel_50)  # -> out, A; inputs path: String, fileName: String, zones: list of GeometryBase
# ---------- c_script_30: C# ----------
    String filePath = path + @"\" + fileName;


    A = filePath;



    File.Delete(filePath);

    using(var tw = new StreamWriter(filePath)) // new StreamWriter(path, true) for append
    {
      tw.Write(dockerCMD);




      tw.Write("splitMeshRegions -cellZones -overwrite");
      tw.WriteLine("\n");
      // tw.WriteLine("PAUSE");


      tw.Close();


    }
# ---------- end c_script_30 ----------
c_script_31 = CSharpScript(path=document_path.A, fileName="run_chtMultiRegionFoam.bat", zones=allgeo, dockerCMD=panel_50)  # -> out, A; inputs path: String, fileName: String, zones: list of GeometryBase
# ---------- c_script_31: C# ----------
    String filePath = path + @"\" + fileName;


    A = filePath;



    File.Delete(filePath);

    using(var tw = new StreamWriter(filePath)) // new StreamWriter(path, true) for append
    {
      tw.Write(dockerCMD);







      //tw.Write("\"");
      tw.Write("chtMultiRegionFoam");
      // tw.WriteLine("PAUSE");


      tw.Close();


    }
# ---------- end c_script_31 ----------
c_script_32 = CSharpScript(path=document_path.A, fileName="run_cellSet.bat", zones=allgeo, dockerCMD=panel_50)  # -> out, A; inputs path: String, fileName: String, zones: list of GeometryBase
# ---------- c_script_32: C# ----------
    String filePath = path + @"\" + fileName;

    A = filePath;

    File.Delete(filePath);

    using(var tw = new StreamWriter(filePath)) // new StreamWriter(path, true) for append
    {
      tw.Write(dockerCMD);

      tw.Write(" setSet -batch system/cellSetDict");
      //tw.WriteLine("\n");
      //tw.WriteLine("PAUSE");

      tw.Close();

    }
# ---------- end c_script_32 ----------
c_script_33 = CSharpScript(path=document_path.A, fileName="plot_residuals.bat", zones=allgeo)  # -> out, A; inputs path: String, fileName: String, zones: list of GeometryBase; disabled; same code as c_script_24
c_script_34 = CSharpScript(path=document_path.A, fileName="run_all.bat", zones=allgeo, dockerCMD=panel_50)  # -> out, A; inputs path: String, fileName: String, zones: list of GeometryBase; same code as c_script_25
c_script_35 = CSharpScript(path=document_path.A, fileName=panel_81, zones=allgeo, dockerCMD=panel_50)  # -> out, A; inputs path: String, fileName: String, zones: list of GeometryBase; disabled
# ---------- c_script_35: C# ----------
    String filePath = path + @"\" + fileName;


    A = filePath;



    File.Delete(filePath);

    using(var tw = new StreamWriter(filePath)) // new StreamWriter(path, true) for append
    {
      tw.Write(dockerCMD);



      foreach(GeometryBase geo in zones){
        tw.Write(@" postProcess -func 'grad(T)' -region " + geo.UserDictionary["name"] + " ; ");
      }





      tw.Write("\"");
      tw.WriteLine("\n");
      tw.WriteLine("PAUSE");


      tw.Close();


    }
# ---------- end c_script_35 ----------
c_script_36 = CSharpScript(path=document_path.A, fileName=panel_82, zoneNames=panel_57, dockerCMD=panel_50)  # -> out, A; inputs path: String, fileName: String, zoneNames: list of String, dockerCMD: String
# ---------- c_script_36: C# usings ----------
using System.IO;
using System.Linq;
using System.Data;
using System.Drawing;
using System.Reflection;
using System.Windows.Forms;
using System.Xml;
using System.Xml.Linq;
using System.Runtime.InteropServices;

using Rhino.DocObjects;
using Rhino.Collections;
using GH_IO;
using GH_IO.Serialization;
using System.Text;
# ---------- c_script_36: C# ----------
    String filePath = path + @"\" + fileName;


    A = filePath;



    File.Delete(filePath);

    using(var tw = new StreamWriter(filePath)) // new StreamWriter(path, true) for append
    {
      // Start the docker command string
      StringBuilder dockerCmd = new StringBuilder();
      dockerCmd.Append(dockerCMD);

      foreach (String zoneName in zoneNames){
        dockerCmd.Append(@"changeDictionary -region """ + zoneName + "; ");
      }

      // End the command
      dockerCmd.Append(@"""");

      tw.WriteLine(dockerCmd.ToString());




    }
# ---------- end c_script_36 ----------

panel_83 = Panel(c_script_36.out)

# ==== cluster BoundingBox
B = ClusterInput()
join = BrepJoin(Breps=B)  # -> Breps, Closed
debrep = DeconstructBrep(Brep=join.Breps)  # -> Faces, Edges, flatten(Vertices)
devec = DeconstructVector(Vector=debrep.Vertices)  # -> XComponent, YComponent, ZComponent
bnd = Bounds(Numbers=devec.ZComponent)
bnd_2 = Bounds(Numbers=devec.YComponent)
bnd_3 = Bounds(Numbers=devec.XComponent)
dedomain = DeconstructDomain(Domain=bnd_2)  # -> Start, End
dedomain_2 = DeconstructDomain(Domain=bnd_3)  # -> Start, End
dedomain_3 = DeconstructDomain(Domain=bnd)  # -> Start, End
pt = ConstructPoint(XCoordinate=dedomain_2.End, YCoordinate=dedomain.End, ZCoordinate=dedomain_3.End)
pt_2 = ConstructPoint(XCoordinate=dedomain.Start, YCoordinate=dedomain.Start, ZCoordinate=dedomain_3.End)
pt_3 = ConstructPoint(XCoordinate=dedomain_2.Start, YCoordinate=dedomain.Start, ZCoordinate=dedomain_3.Start)
pt_4 = ConstructPoint(XCoordinate=dedomain_2.Start, YCoordinate=dedomain.Start, ZCoordinate=dedomain_3.Start)
pt_5 = ConstructPoint(XCoordinate=dedomain_2.End, YCoordinate=dedomain.End, ZCoordinate=dedomain_3.Start)
pt_6 = ConstructPoint(XCoordinate=dedomain_2.Start, YCoordinate=dedomain.End, ZCoordinate=dedomain_3.Start)
pt_7 = ConstructPoint(XCoordinate=dedomain_2.Start, YCoordinate=dedomain.Start, ZCoordinate=dedomain_3.Start)
pt_8 = ClusterOutput(pt)
pt_9 = ClusterOutput(pt_5)
pt_10 = ClusterOutput(pt_7)
vec = VectorXYZ(XComponent=pt_7, YComponent=pt_3, ZComponent=pt_2)  # -> Vector, Length
rec_3pt = Rectangle3Pt(PointA=pt_7, PointB=pt_6, PointC=pt_5)  # -> Rectangle, Length
V = ClusterOutput(vec.Vector)
extr = Extrude(Base=rec_3pt.Rectangle, Direction=vec.Vector)
E = ClusterOutput(extr)

# ==== cluster ExtractOrthogonalFaces
B = ClusterInput()
join = BrepJoin(Breps=B)  # -> Breps, Closed
mesh = MeshBrep(
    Brep=join.Breps,
    Settings={GridMaxCount=0, GridMinCount=16, JaggedSeams=False, MaxEdgeLength=0, MinEdgeLength=0.0001, MinTolerance=0, Refine=True, RefineAngle=0, RelativeTolerance=0.65, SimplePlanes=True, Tolerance=0})
mjoin = MeshJoin(Meshes=mesh)
demesh = DeconstructMesh(Mesh=mjoin)  # -> Vertices, Faces, Colours, Normals
B_2 = ClusterInput()
facen = FaceNormals(Mesh=mjoin)  # -> Centers, Normals
dprod = DotProduct(VectorA=facen.Normals, VectorB=B_2, Unitize=True)
B_3 = ClusterInput()
equals = Equality(FirstNumber=dprod, SecondNumber=B_3)  # -> Equality, Inequality
cullf = CullFaces(Mesh=mjoin, Pattern=equals.Inequality)
M = ClusterOutput(cullf)

# ==== cluster ToKelvin
A = ClusterInput()
addition = Addition(A=A, B="+272.15")
R = ClusterOutput(addition)
